# Grasshopper definition extended-pipe-bending.gh (Grasshopper 1.0.8)
# plug-ins: Fologram For Grasshopper Utilities, Fologram for Grasshopper

# Extended Bending Machine
# Nora Merten
# mail@mertena.de
augdoc = AugmentedDocument(augmented_trigger_1_key=button_previousstep, augmented_trigger_2_key=button_nextstep, num_augmented_triggers=3)

number_pinradius = Slider(19.5, range=0..100)
number_pindistance = Slider(259, range=0..1000)
# Global Bending Parameters
# adjust for entire bending sequence by measuring the parameters for the bending machine at a given pipe diameter
number_piperadius = Slider(11, range=0..100)
number_bendradius = Slider(49.65, range=0..1000)

# ---- group: input curve
curve_inputcurve = Curve(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)

# ----
toggle_flipcurve = BooleanToggle(False)
selector_divisiontype = ValueList({"by Count (Default)": 0, "by Length": 1}, selected="by Count (Default)")
number_inputsegmentcount = Slider(11, range=2..100)
number_inputsegmentlength = Slider(301, range=0..1000)
toggle_overridelimits = BooleanToggle(False)

# ----
# Create a bendable curve
# or construct manually using polyline and filleted corners with fixed radius
number_bendradius_2 = Number(number_bendradius)
number_pindistance_2 = Number(number_pindistance)
cluster_bendsegmentation = ClusterBendSegmentation(
    curve_inputcurve=curve_inputcurve,
    boolean_flipcurve=toggle_flipcurve,
    integer_divisiontype=selector_divisiontype,
    number_inputsegmentcount=number_inputsegmentcount,
    number_inputsegmentlength=number_inputsegmentlength,
    boolean_overridelimits=toggle_overridelimits,
    number_pindistance=number_pindistance_2,
    number_bendradius=number_bendradius_2)  # -> curve_manufacturingcurve_2, number_segmentlength_2, integer_segmentcount_2, number_minimumsegmentlength_2, number_maximumsegmentcount_2
current_segment_length = Panel(cluster_bendsegmentation.number_segmentlength_2)
current_segment_count = Panel(cluster_bendsegmentation.integer_segmentcount_2)
minimum_segment_length = Panel(cluster_bendsegmentation.number_minimumsegmentlength_2)
maximum_segment_count = Panel(cluster_bendsegmentation.number_maximumsegmentcount_2)

# ---- group: preview bend segmentation
number_piperadius_2 = Number(number_piperadius)
pipe = Pipe(Curve=cluster_bendsegmentation.curve_manufacturingcurve_2, Radius=number_piperadius_2, Caps=0, FitRail=False)
custom_preview = CustomPreview(Geometry=pipe, Material=ColourSwatch(SwatchColor=RGBA(94, 145, 0, 207)))

# ----
selector_partsegmentationtype = ValueList({"by PartCount (Default)": 0, "by SegmentsPerPart": 1, "Manual": 2}, selected="by PartCount (Default)")
partsegmentcount = Slider(7, range=1..50)
number_partcount = Slider(2, range=2..50)

# ----
# Divide into parts (optional)
# skip if you only want to bend one part
curve_manufacturingcurve = Curve(cluster_bendsegmentation.curve_manufacturingcurve_2)
point_manualbreakpoints = Point()
cluster_partsegmentation = ClusterPartSegmentation(
    curve_manufacturingcurve=curve_manufacturingcurve,
    integer_segmentationtype=selector_partsegmentationtype,
    integer_inputpartcount=number_partcount,
    integer_inputpartsegmentcount=partsegmentcount,
    point_manualbreakpoints=point_manualbreakpoints)  # -> data_parts_2, integer_partcount_2, number_largestpartlength_2, number_smallestpartlength_2
current_largest_part_length = Panel(cluster_partsegmentation.number_largestpartlength_2)
current_smallest_part_length = Panel(cluster_partsegmentation.number_smallestpartlength_2)
current_part_count = Panel(cluster_partsegmentation.integer_partcount_2)

# ---- group: preview parts
number_selection = Slider(0, range=0..10)
list_item = ListItem(List=cluster_partsegmentation.data_parts_2, Index=number_selection, Wrap=True)
number_piperadius_3 = Number(number_piperadius)
pipe_2 = Pipe(Curve=list_item, Radius=number_piperadius_3, Caps=0, FitRail=False)
custom_preview_2 = CustomPreview(Geometry=pipe_2, Material=ColourSwatch(SwatchColor=RGBA(0, 131, 145, 207)))

# ---- group: extended bending / material
number_transparencyreference = Slider(0, range=0..1)
number_transparencyselection = Slider(0, range=0..1)
number_transparencypipes = Slider(0.777, range=0..1)
colour_reference = ColourSwatch(SwatchColor=RGB(255, 254, 254))
colour_target = ColourSwatch(SwatchColor=RGB(255, 107, 44))
colour_base = ColourSwatch(SwatchColor=RGB(255, 254, 254))

# ---- group: extended bending / XR marker label
panel = Panel("marker-name")

# ---- group: extended bending
curve_parts = Curve(cluster_partsegmentation.data_parts_2)
create_material = CreateMaterial(
    Diffuse=colour_target,
    Specular=RGB(255, 254, 254),
    Emission=RGB(0, 0, 0),
    Transparency=number_transparencyselection,
    Shine=0)
data_materialselection = Data(create_material)
curve_environmentmodel = Curve([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])

get_qr_codes = GetQRCodes(Event=31, Labels=panel, outputAllData=True)  # -> flatten(QRCodes); disabled
list_item_2 = ListItem(List=get_qr_codes, Index=0, Wrap=True)  # disabled
deconstruct_qr_code = DeconstructQRCode(QRCode=list_item_2)  # -> Device, Rectangle, Label, Age; disabled

mesh_previouspartbutton = Mesh(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)
brep_previouspartbutton = Brep(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)

mesh_nextpartbutton = Mesh(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)
brep_nextpartbutton = Brep(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)

mesh_previousstepbutton = Mesh(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)
brep_previousstepbutton = Brep(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)

mesh_nextstepbutton = Mesh(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)
brep_nextstepbutton = Brep(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)

create_material_2 = CreateMaterial(
    Diffuse=colour_target,
    Specular=RGB(255, 254, 254),
    Emission=RGB(0, 0, 0),
    Transparency=number_transparencypipes,
    Shine=0)
create_material_3 = CreateMaterial(Diffuse=colour_base, Specular=RGB(255, 254, 254), Emission=RGB(0, 0, 0), Transparency=number_transparencypipes, Shine=0)
create_material_4 = CreateMaterial(
    Diffuse=colour_reference,
    Specular=RGB(255, 254, 254),
    Emission=RGB(0, 0, 0),
    Transparency=number_transparencyreference,
    Shine=0)
data_materialafter = Data(create_material_2)
data_materialreference = Data(create_material_4)
data_materialbefore = Data(create_material_3)

# ---- group: extended bending / bending machine control
number_partselection = Slider(0, range=0..20)
number_stepselection = Slider(0, range=0..20)
toggle_overridepartselection = BooleanToggle(False)
toggle_overridestepselection = BooleanToggle(False)
button_resetpartselection = Button()
button_resetstepselection = Button()
button_previouspart = Button()
button_previousstep = Button()
button_nextpart = Button()
button_nextstep = Button()

# ---- group: extended bending / AR interface
sync_geometry = SyncGeometry(Geometry=mesh_nextpartbutton, Material=data_materialselection, Interactions=1, DisplayMode=2)
sync_geometry_2 = SyncGeometry(Geometry=mesh_nextstepbutton, Material=data_materialselection, Interactions=1, DisplayMode=2)
sync_geometry_3 = SyncGeometry(Geometry=mesh_previouspartbutton, Material=data_materialreference, Interactions=1, DisplayMode=2)
sync_geometry_4 = SyncGeometry(Geometry=mesh_previousstepbutton, Material=data_materialreference, Interactions=1, DisplayMode=2)
on_tap = OnTap(SyncGeometry=sync_geometry_2)  # -> Enabled, Interactor
on_tap_2 = OnTap(SyncGeometry=sync_geometry_3)  # -> Enabled, Interactor
on_tap_3 = OnTap(SyncGeometry=sync_geometry_4)  # -> Enabled, Interactor
on_tap_4 = OnTap(SyncGeometry=sync_geometry)  # -> Enabled, Interactor
counter = Counter(Trigger=[button_nextstep, on_tap.Enabled], Reset=button_resetstepselection)  # -> expr("x/2", Count)
counter_2 = Counter(Trigger=[button_nextpart, on_tap_4.Enabled], Reset=button_resetpartselection)  # -> expr("x/2", Count)
counter_3 = Counter(Trigger=[button_previouspart, on_tap_2.Enabled], Reset=button_resetpartselection)  # -> expr("-x/2", Count)
counter_4 = Counter(Trigger=[button_previousstep, on_tap_3.Enabled], Reset=button_resetstepselection)  # -> expr("-x/2", Count)

# ---- group: extended bending
number_scalefactor = Slider(0.2, range=0..1)
number_angle = Slider(-75, range=-90..90)
number_offset = Slider(600, range=0..1000)
number_offset_2 = Slider(500, range=0..2000)
number_offset_3 = Slider(500, range=0..500)

number_offset_4 = Slider(200, range=0..200)
number_offset_5 = Slider(250, range=0..500)

number_length = Slider(200, range=0..1000)
number_offset_6 = Slider(0, range=0..100)
number_offset_7 = Slider(-22, range=-100..100)
number_offset_8 = Slider(0, range=0..100)

# ---- group: extended bending / bending machine setup
number_baseplaneangle = Slider(90.2, range=-180..180)
number_offset_9 = Slider(40.901, range=-400..400)
number_offset_10 = Slider(-56, range=-400..400)
number_offset_11 = Slider(30.328, range=-400..400)

# ---- group: extended bending / main bending instructions display
number_pindistance_3 = Number(number_pindistance)
number_piperadius_4 = Number(number_piperadius)
number_pinradius_2 = Number(number_pinradius)
cluster_extendedbendingmachine = ClusterExtendedBendingMachine(
    data_parts=curve_parts,
    integer_previouspartcount=counter_3,
    integer_nextpartcount=counter_2,
    boolean_overridepartselection=toggle_overridepartselection,
    integer_partselection=number_partselection,
    integer_previousstepcount=counter_4,
    integer_nextstepcount=counter,
    boolean_overridestepselection=toggle_overridestepselection,
    integer_stepselection=number_stepselection,
    number_piperadius=number_piperadius_4,
    number_pindistance=number_pindistance_3,
    number_pinradius=number_pinradius_2,
    plane_baseplane=deconstruct_qr_code.Rectangle,
    number_offsetx=number_offset_9,
    number_offsety=number_offset_11,
    number_offsetz=number_offset_10,
    number_baseplanerotation=number_baseplaneangle)  # -> mesh_pipebefore, mesh_pipeafter, brep_pipebefore, brep_pipeafter, curve_pipebefore, curve_pipeafter, curve_pipebeforeedges, curve_pipeafteredges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
sync_geometry_5 = SyncGeometry(
    Geometry=[cluster_extendedbendingmachine.curve_pipebeforeedges, cluster_extendedbendingmachine.curve_pipeafteredges],
    Material=data_materialreference,
    DisplayMode=2)
sync_geometry_6 = SyncGeometry(Geometry=cluster_extendedbendingmachine.mesh_pipeafter, Material=data_materialafter, DisplayMode=0)
sync_geometry_7 = SyncGeometry(Geometry=cluster_extendedbendingmachine.mesh_pipebefore, Material=data_materialbefore, DisplayMode=0)

# ---- group: extended bending / status interface
plane_baseplane = Plane(cluster_extendedbendingmachine.plane_baseplane_2)
deconstruct_plane = DeconstructPlane(Plane=plane_baseplane)  # -> Origin, XAxis, YAxis, ZAxis
point_oriented = PointOriented(BasePlane=plane_baseplane, UComponent=number_offset, VComponent=number_offset_2, WComponent=number_offset_3)
bounding_box = BoundingBox(Content=flatten(curve_environmentmodel), Plane=PlaneXY(0, 0, 0), UnionBox=True)  # -> Box, Box_2
construct_plane = ConstructPlane(Origin=point_oriented, XAxis=deconstruct_plane.XAxis, YAxis=deconstruct_plane.YAxis)
volume = Volume(Geometry=bounding_box.Box)  # -> Volume, Centroid
number_offset_12 = Slider(0, range=0..100)
number_tuberadius = Number(number_piperadius)
rotate_plane = RotatePlane(Plane=construct_plane, Angle=degrees(number_angle))
xy_plane = XYPlane(Origin=volume.Centroid)
addition = Addition(A=number_tuberadius, B=number_offset_12)
scale = Scale(Center=volume.Centroid, Factor=number_scalefactor)  # -> Geometry, Transform
data_unmanufacturedparts = Data(cluster_extendedbendingmachine.data_unmanufacturedparts)
orient = Orient(Source=xy_plane, Target=rotate_plane)  # -> Geometry, Transform
data_manufacturedparts = Data(cluster_extendedbendingmachine.data_manufacturedparts)
data_selectedpart = Data(cluster_extendedbendingmachine.data_selectedpart)
mesh_pipe = MeshPipe(Polylines=data_unmanufacturedparts, NumberOfSides=8, Tolerance=0.1, Radius=addition, Cap=False, Join=False)
mesh_pipe_2 = MeshPipe(Polylines=data_selectedpart, NumberOfSides=4, Tolerance=0.1, Radius=addition, Cap=False, Join=False)
mesh_pipe_3 = MeshPipe(Polylines=data_manufacturedparts, NumberOfSides=4, Tolerance=0.1, Radius=addition, Cap=False, Join=False)
merge = Merge(Data1=scale.Transform, Data2=orient.Transform)
compound = Compound(Transforms=flatten(merge))
clean_tree = CleanTree(RemoveNulls=True, RemoveInvalid=True, RemoveEmpty=True, Tree=mesh_pipe_3)
clean_tree_2 = CleanTree(RemoveNulls=True, RemoveInvalid=True, RemoveEmpty=True, Tree=mesh_pipe_2)
clean_tree_3 = CleanTree(RemoveNulls=True, RemoveInvalid=True, RemoveEmpty=True, Tree=mesh_pipe)
clean_tree_4 = CleanTree(RemoveNulls=True, RemoveInvalid=True, RemoveEmpty=True, Tree=curve_environmentmodel)
data_materialreference_2 = Data(create_material_4)
data_materialselection_2 = Data(create_material)
data_materialbefore_2 = Data(create_material_3)
data_materialafter_2 = Data(create_material_2)
sync_geometry_8 = SyncGeometry(Geometry=clean_tree_4, Material=data_materialreference_2, Transform=compound)
sync_geometry_9 = SyncGeometry(Geometry=clean_tree_3, Material=data_materialbefore_2, Transform=compound)
sync_geometry_10 = SyncGeometry(Geometry=clean_tree_2, Material=data_materialselection_2, DisplayMode=0, Transform=compound)
sync_geometry_11 = SyncGeometry(Geometry=clean_tree, Material=data_materialafter_2, DisplayMode=0, Transform=compound)

# ---- group: extended bending / reference edges / create reference curves
plane_baseplane_2 = Plane(cluster_extendedbendingmachine.plane_baseplane_2)
point_oriented_2 = PointOriented(BasePlane=PlaneXY(0, 0, 0), UComponent=number_offset_6, VComponent=number_offset_7, WComponent=number_offset_8)
negative = Negative(Value=number_length)
deconstruct_plane_2 = DeconstructPlane(Plane=plane_baseplane_2)  # -> Origin, XAxis, YAxis, ZAxis
number_pinradius_3 = Number(number_pinradius)
plane_pinplanes = Plane(cluster_extendedbendingmachine.plane_pinplanes)
line_sdl = LineSDL(Start=point_oriented_2, Direction=deconstruct_plane_2.YAxis, Length=graft([number_length, negative]))  # -> flatten(Line)
circle = Circle(Plane=plane_pinplanes, Radius=number_pinradius_3)
line_sdl_2 = LineSDL(Start=plane_pinplanes, Direction=deconstruct_plane_2.ZAxis, Length=graft([50, -50]))  # -> flatten(Line)
curve_machinereference = Curve(line_sdl)
curve_pinreference = Curve([circle, line_sdl_2])

# ----
curve_reference = Curve([curve_machinereference, curve_pinreference])
curve_pipeedges = Curve([cluster_extendedbendingmachine.curve_pipebeforeedges, cluster_extendedbendingmachine.curve_pipeafteredges])
brep_pipes = Brep([cluster_extendedbendingmachine.brep_pipeafter, cluster_extendedbendingmachine.brep_pipebefore])
curve_pipes = Curve([cluster_extendedbendingmachine.curve_pipebefore, cluster_extendedbendingmachine.curve_pipeafter])

# ---- group: extended bending / reference edges / create part-step indicator
curve_selectedpart = Curve(cluster_extendedbendingmachine.data_selectedpart)
length = Length(Curve=curve_selectedpart)
plane_baseplane_3 = Plane(cluster_extendedbendingmachine.plane_baseplane_2)
round = Round(Number=length)  # -> Nearest, Floor, Ceiling
integer_partselectionindex = Integer(expr("x+1", cluster_extendedbendingmachine.integer_partselectionindex))
integer_stepselectionindex = Integer(expr("x+1", cluster_extendedbendingmachine.integer_stepselectionindex))
point_oriented_3 = PointOriented(BasePlane=plane_baseplane_3, UComponent=0, VComponent=0, WComponent=number_offset_5)
point_oriented_4 = PointOriented(BasePlane=plane_baseplane_3, UComponent=0, VComponent=0, WComponent=number_offset_4)

# ---- group: extended bending / reference edges
integer_partcount = Integer(cluster_extendedbendingmachine.integer_partcount)
integer_stepcount = Integer(cluster_extendedbendingmachine.integer_stepcount)

# ---- group: extended bending / reference edges / create part-step indicator (continued)
concatenate = Concatenate(_1="Step ", _2=integer_stepselectionindex, _3="/", _4=integer_stepcount)
concatenate_2 = Concatenate(_1="Part ", _2=integer_partselectionindex, _3="/", _4=integer_partcount, _5=" (", _6=round.Nearest, _7="mm)")
construct_text_dot = ConstructTextDot(Text=concatenate, Point=point_oriented_4, Size=14)
construct_text_dot_2 = ConstructTextDot(Text=concatenate_2, Point=point_oriented_3, Size=14)

# ---- group: extended bending / reference edges (continued)
clean_tree_5 = CleanTree(
    RemoveNulls=True,
    RemoveInvalid=True,
    RemoveEmpty=True,
    Tree=[construct_text_dot_2, construct_text_dot, curve_pinreference, curve_machinereference])
sync_geometry_12 = SyncGeometry(Geometry=clean_tree_5, Material=data_materialreference, DisplayMode=2)

# ==== cluster ClusterPartSegmentation: This Cluster segments the ManufacturingCurve (output from the BendSegmentation) into subparts.
integer_inputpartsegmentcount = ClusterInput()
curve_manufacturingcurve = ClusterInput()
integer_segmentationtype = ClusterInput()
point_manualbreakpoints = ClusterInput()
integer_inputpartcount = ClusterInput()
curve_manufacturingcurve_2 = Curve(curve_manufacturingcurve)
explode = Explode(Curve=curve_manufacturingcurve_2, Recursive=True)  # -> Segments, Vertices
shift_list = ShiftList(List=explode.Segments, Shift=1, Wrap=False)
explode_2 = Explode(Curve=curve_manufacturingcurve_2, Recursive=True)  # -> Segments, Vertices
cull_nth = CullNth(List=shift_list, CullFrequency=2)
cull_nth_2 = CullNth(List=explode_2.Segments, CullFrequency=2)
list_length = ListLength(List=cull_nth)
integer_inputpartsegmentcount_2 = Integer(integer_inputpartsegmentcount)
curve_middle = CurveMiddle(Curve=cull_nth_2)
integer_inputpartcount_2 = Integer(integer_inputpartcount)
integer_segmentcount = Integer(list_length)
division = Division(A=integer_segmentcount, B=integer_inputpartcount_2)
division_2 = Division(A=integer_segmentcount, B=integer_inputpartsegmentcount_2)
round = Round(Number=division)  # -> Nearest, Floor, Ceiling
round_2 = Round(Number=division_2)  # -> Nearest, Floor, Ceiling
point_manualbreakpoints_2 = Point(point_manualbreakpoints)
series = Series(Start=round.Ceiling, Step=round.Ceiling, Count=expr("x-1", integer_inputpartcount_2))  # -> expr("x-1", Series)
series_2 = Series(Start=integer_inputpartsegmentcount_2, Step=integer_inputpartsegmentcount_2, Count=round_2.Floor)
closest_point = ClosestPoint(Point=point_manualbreakpoints_2, Cloud=curve_middle)  # -> ClosestPoint, CPIndex, Distance
list_item = ListItem(List=curve_middle, Index=series_2, Wrap=True)
list_item_2 = ListItem(List=curve_middle, Index=series, Wrap=False)
integer_segmentationtype_2 = Integer(integer_segmentationtype)
combine_data = CombineData(Input0=integer_segmentationtype_2, Input1=0)  # -> Result, Index
stream_filter = StreamFilter(Gate=combine_data.Result, Stream0=list_item_2, Stream1=list_item, Stream2=closest_point.ClosestPoint)
curve_closest_point = CurveClosestPoint(Point=stream_filter, Curve=curve_manufacturingcurve_2)  # -> Point, Parameter, Distance
shatter = Shatter(Curve=curve_manufacturingcurve_2, Parameters=curve_closest_point.Parameter)
length = Length(Curve=shatter)
list_length_2 = ListLength(List=shatter)
data_parts = Data(shatter)
sort_list = SortList(Keys=length, ValuesValuesA=length)  # -> Keys, ValuesValuesA
integer_partcount = Integer(list_length_2)
list_item_3 = ListItem(List=sort_list.ValuesValuesA, Index=-1, Wrap=True)
list_item_4 = ListItem(List=sort_list.ValuesValuesA, Index=0, Wrap=True)
number_largestpartlength = Number(list_item_3)
number_smallestpartlength = Number(list_item_4)
data_parts_2 = ClusterOutput(data_parts)
integer_partcount_2 = ClusterOutput(integer_partcount)
number_smallestpartlength_2 = ClusterOutput(number_smallestpartlength)
number_largestpartlength_2 = ClusterOutput(number_largestpartlength)

# ==== cluster ClusterBendSegmentation
number_inputsegmentlength = ClusterInput()
number_inputsegmentcount = ClusterInput()
boolean_overridelimits = ClusterInput()
number_pindistance = ClusterInput()
number_bendradius = ClusterInput()
integer_divisiontype = ClusterInput()
curve_inputcurve = ClusterInput()
boolean_flipcurve = ClusterInput()

toggle_flipcurve = BooleanToggle(False)
curve_inputcurve_2 = Curve(reparameterize(curve_inputcurve))
boolean_flipcurve_2 = Boolean(boolean_flipcurve)
flip_curve = FlipCurve(Curve=curve_inputcurve_2)  # -> Curve, Flag
combine_data = CombineData(Input0=boolean_flipcurve_2, Input1=toggle_flipcurve)  # -> Result, Index
stream_filter = StreamFilter(Gate=combine_data.Result, Stream0=curve_inputcurve_2, Stream1=flip_curve.Curve)
length = Length(Curve=stream_filter)

number_bendradius_2 = Number(number_bendradius)
number_pindistance_2 = Number(number_pindistance)
division = Division(A=number_pindistance_2, B=2)
multiplication = Multiplication(A=number_bendradius_2, B=2)
addition = Addition(A=division, B=multiplication)
number_minimumsegmentlength = Number(addition)
division_2 = Division(A=length, B=number_minimumsegmentlength)
round = Round(Number=division_2)  # -> Nearest, Floor, Ceiling
number_maximumsegmentcount = Number(round.Floor)

boolean_overridelimits_2 = Boolean(boolean_overridelimits)

number_inputsegmentlength_2 = Number(number_inputsegmentlength)
smaller_than = SmallerThan(FirstNumber=number_inputsegmentlength_2, SecondNumber=length)  # -> SmallerThan, OrEqualTo
larger_than = LargerThan(FirstNumber=number_inputsegmentlength_2, SecondNumber=number_minimumsegmentlength)  # -> LargerThan, OrEqualTo
gate_and = GateAnd(A=larger_than.OrEqualTo, B=smaller_than.OrEqualTo)
stream_filter_2 = StreamFilter(Gate=gate_and, Stream0=number_minimumsegmentlength, Stream1=number_inputsegmentlength_2)
stream_filter_3 = StreamFilter(Gate=boolean_overridelimits_2, Stream0=stream_filter_2, Stream1=number_inputsegmentlength_2)

number_inputsegmentcount_2 = Number(number_inputsegmentcount)
larger_than_2 = LargerThan(FirstNumber=number_inputsegmentcount_2, SecondNumber=1)  # -> LargerThan, OrEqualTo
smaller_than_2 = SmallerThan(FirstNumber=number_inputsegmentcount_2, SecondNumber=number_maximumsegmentcount)  # -> SmallerThan, OrEqualTo
gate_and_2 = GateAnd(A=smaller_than_2.OrEqualTo, B=larger_than_2.OrEqualTo)
stream_filter_4 = StreamFilter(Gate=gate_and_2, Stream0=number_maximumsegmentcount, Stream1=number_inputsegmentcount_2)
stream_filter_5 = StreamFilter(Gate=boolean_overridelimits_2, Stream0=stream_filter_4, Stream1=number_inputsegmentcount_2)

division_3 = Division(A=length, B=stream_filter_5)
division_4 = Division(A=length, B=stream_filter_3)
integer_divisiontype_2 = Integer(integer_divisiontype)
round_2 = Round(Number=division_4)  # -> Nearest, Floor, Ceiling
modulus = Modulus(A=length, B=round_2.Floor)
stream_filter_6 = StreamFilter(Gate=integer_divisiontype_2, Stream0=division_3, Stream1=stream_filter_3)
stream_filter_7 = StreamFilter(Gate=integer_divisiontype_2, Stream0=stream_filter_5, Stream1=modulus)
number_segmentlength = Number(stream_filter_6)
integer_segmentcount = Integer(stream_filter_7)
divide_length = DivideLength(Curve=stream_filter, Length=number_segmentlength)  # -> Points, Tangents, Parameters
polyline = PolyLine(Vertices=divide_length.Points, Closed=False)
number_bendradius_3 = Number(number_bendradius)
fillet = Fillet(Curve=polyline, Radius=number_bendradius_3)
curve_manufacturingcurve = Curve(fillet)
number_segmentlength_2 = ClusterOutput(number_segmentlength)
curve_manufacturingcurve_2 = ClusterOutput(curve_manufacturingcurve)
integer_segmentcount_2 = ClusterOutput(integer_segmentcount)
number_maximumsegmentcount_2 = ClusterOutput(number_maximumsegmentcount)
number_minimumsegmentlength_2 = ClusterOutput(number_minimumsegmentlength)

# ==== cluster ClusterExtendedBendingMachine
boolean_overridepartselection = ClusterInput()
boolean_overridestepselection = ClusterInput()
integer_previouspartcount = ClusterInput()
integer_previousstepcount = ClusterInput()
number_baseplanerotation = ClusterInput()
integer_nextpartcount = ClusterInput()
integer_nextstepcount = ClusterInput()
integer_partselection = ClusterInput()
integer_stepselection = ClusterInput()
number_pindistance = ClusterInput()
number_piperadius = ClusterInput()
number_pinradius = ClusterInput()
plane_baseplane = ClusterInput()
number_offsetx = ClusterInput()
number_offsetz = ClusterInput()
number_offsety = ClusterInput()
data_parts = ClusterInput()
cluster_selection = ClusterSelection(
    boolean_overridepartselection=boolean_overridepartselection,
    integer_previouspartcount=integer_previouspartcount,
    integer_nextpartcount=integer_nextpartcount,
    integer_partselection=integer_partselection,
    data_parts=data_parts,
    boolean_overridestepselection=boolean_overridestepselection,
    integer_previousstepcount=integer_previousstepcount,
    integer_nextstepcount=integer_nextstepcount,
    integer_stepselection=integer_stepselection)  # -> integer_partselectionindex_2, integer_partcount_2, data_selectedpart_3, data_manufacturedparts_2, data_unmanufacturedparts_2, integer_stepselectionindex_2, integer_stepcount_2, curve_bendingstart_2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
cluster_baseplane = ClusterBasePlane(
    number_offsetx=number_offsetx,
    number_offsety=number_offsety,
    number_offsetz=number_offsetz,
    number_pindistance=number_pindistance,
    plane_baseplane=plane_baseplane,
    number_baseplanerotation=number_baseplanerotation)  # -> plane_baseplane_4, plane_pinplanes_2, plane_leftpinplane_2, plane_rightpinplane_2
cluster_orientpipes = ClusterOrientPipes(
    curve_beforebending=cluster_selection.curve_beforebending_2,
    curve_bendingarc=cluster_selection.curve_bendingarc_2,
    plane_pinplane=cluster_baseplane.plane_rightpinplane_2,
    curve_afterbending=cluster_selection.curve_afterbending_2,
    number_pindistance=number_pindistance,
    number_pinradius=number_pinradius,
    number_piperadius=number_piperadius,
    plane_baseplane=cluster_baseplane.plane_baseplane_4)  # -> curve_pipebeforeedges_2, curve_pipebefore_3, brep_pipebefore_2, mesh_pipebefore_2, curve_pipeafter_3, mesh_pipeafter_2, brep_pipeafter_2, curve_pipeafteredges_2
brep_pipebefore = ClusterOutput(cluster_orientpipes.brep_pipebefore_2)
plane_pinplanes = ClusterOutput(cluster_baseplane.plane_pinplanes_2)
brep_pipeafter = ClusterOutput(cluster_orientpipes.brep_pipeafter_2)
data_selectedpart = ClusterOutput(cluster_selection.data_selectedpart_3)
mesh_pipebefore = ClusterOutput(cluster_orientpipes.mesh_pipebefore_2)
mesh_pipeafter = ClusterOutput(cluster_orientpipes.mesh_pipeafter_2)
curve_pipebefore = ClusterOutput(cluster_orientpipes.curve_pipebefore_3)
integer_partselectionindex = ClusterOutput(cluster_selection.integer_partselectionindex_2)
integer_stepselectionindex = ClusterOutput(cluster_selection.integer_stepselectionindex_2)
data_manufacturedparts = ClusterOutput(cluster_selection.data_manufacturedparts_2)
data_unmanufacturedparts = ClusterOutput(cluster_selection.data_unmanufacturedparts_2)
curve_unbent = ClusterOutput(cluster_selection.curve_unbent_2)
plane_baseplane_2 = ClusterOutput(cluster_baseplane.plane_baseplane_4)
curve_pipebeforeedges = ClusterOutput(cluster_orientpipes.curve_pipebeforeedges_2)
curve_bending = ClusterOutput(cluster_selection.curve_bending_2)
curve_pipeafter = ClusterOutput(cluster_orientpipes.curve_pipeafter_3)
curve_bent = ClusterOutput(cluster_selection.curve_bent_2)
curve_pipeafteredges = ClusterOutput(cluster_orientpipes.curve_pipeafteredges_2)
integer_partcount = ClusterOutput(cluster_selection.integer_partcount_2)
integer_stepcount = ClusterOutput(cluster_selection.integer_stepcount_2)

# ==== cluster ClusterBasePlane
plane_baseplane = ClusterInput()
number_offsety = ClusterInput()
number_offsetz = ClusterInput()
number_offsetx = ClusterInput()
number_offsetx_2 = Number(number_offsetx)
number_offsety_2 = Number(number_offsety)
number_offsetz_2 = Number(number_offsetz)
plane_baseplane_2 = Plane(plane_baseplane)
combine_data = CombineData(Input0=number_offsety_2, Input1=0)  # -> Result, Index
combine_data_2 = CombineData(Input0=number_offsetz_2, Input1=0)  # -> Result, Index
combine_data_3 = CombineData(Input0=number_offsetx_2, Input1=0)  # -> Result, Index
construct_point = ConstructPoint(XCoordinate=combine_data_3.Result, YCoordinate=combine_data.Result, ZCoordinate=combine_data_2.Result)
combine_data_4 = CombineData(Input0=plane_baseplane_2, Input1=construct_point)  # -> Result, Index
deconstruct_plane = DeconstructPlane(Plane=combine_data_4.Result)  # -> Origin, XAxis, YAxis, ZAxis
construct_plane = ConstructPlane(Origin=construct_point, XAxis=deconstruct_plane.XAxis, YAxis=deconstruct_plane.YAxis)
number_baseplanerotation = ClusterInput()
number_baseplanerotation_2 = Number(number_baseplanerotation)
rotate_plane = RotatePlane(Plane=construct_plane, Angle=degrees(number_baseplanerotation_2))  # -> flatten(Plane)
list_item = ListItem(List=rotate_plane, Index=0, Wrap=True)
plane_baseplane_3 = Plane(list_item)
plane_baseplane_4 = ClusterOutput(plane_baseplane_3)
deconstruct_plane_2 = DeconstructPlane(Plane=plane_baseplane_3)  # -> Origin, XAxis, YAxis, ZAxis
number_pindistance = ClusterInput()
number_pindistance_2 = Number(number_pindistance)
division = Division(A=number_pindistance_2, B=2)
negative = Negative(Value=division)
point_oriented = PointOriented(BasePlane=plane_baseplane_3, UComponent=0, VComponent=[division, negative], WComponent=0)
construct_plane_2 = ConstructPlane(Origin=point_oriented, XAxis=deconstruct_plane_2.XAxis, YAxis=deconstruct_plane_2.YAxis)
list_item_2 = ListItem(List=construct_plane_2, Index=0, Wrap=True)
plane_pinplanes = Plane(construct_plane_2)
list_item_3 = ListItem(List=construct_plane_2, Index=1, Wrap=True)
plane_rightpinplane = Plane(list_item_3)
plane_leftpinplane = Plane(list_item_2)
plane_pinplanes_2 = ClusterOutput(plane_pinplanes)
plane_leftpinplane_2 = ClusterOutput(plane_leftpinplane)
plane_rightpinplane_2 = ClusterOutput(plane_rightpinplane)

# ==== cluster ClusterOrientPipes

curve_bendingarc = ClusterInput()
curve_bendingarc_2 = Curve(reparameterize(curve_bendingarc))
deconstruct_arc = DeconstructArc(Arc=curve_bendingarc_2)  # -> BasePlane, Radius, Angle
number_bendangle = Number(deconstruct_arc.Angle)
number_piperadius = ClusterInput()
number_pinradius = ClusterInput()
number_piperadius_2 = Number(number_piperadius)
deconstruct_domain = DeconstructDomain(Domain=number_bendangle)  # -> Start, End
number_pinradius_2 = Number(number_pinradius)
addition = Addition(A=number_pinradius_2, B=number_piperadius_2)
division = Division(A=deconstruct_domain.End, B=2)
plane_pinplane = ClusterInput()
plane_pinplane_2 = Plane(plane_pinplane)
arc = Arc(Plane=plane_pinplane_2, Radius=addition, Angle=division)  # -> Arc, Length
evaluate_curve = EvaluateCurve(Curve=reparameterize(arc.Arc), Parameter=0)  # -> Point, Tangent, Angle
evaluate_curve_2 = EvaluateCurve(Curve=reparameterize(arc.Arc), Parameter=1)  # -> Point, Tangent, Angle
point_startcontactpoint = Point(evaluate_curve.Point)
plane_baseplane = ClusterInput()
point_endcontactpoint = Point(evaluate_curve_2.Point)
plane_baseplane_2 = Plane(plane_baseplane)
plane_coordinates = PlaneCoordinates(Point=point_endcontactpoint, System=plane_baseplane_2)  # -> XCoordinate, YCoordinate, ZCoordinate
number_pindistance = ClusterInput()
number_pindistanceangled = Number(plane_coordinates.YCoordinate)
number_pindistance_2 = Number(number_pindistance)
division_2 = Division(A=number_pindistance_2, B=2)
absolute = Absolute(Value=number_pindistanceangled)
merge = Merge(Data1=division_2, Data2=absolute)  # -> graft(Result)
evaluate_curve_3 = EvaluateCurve(Curve=reparameterize(curve_bendingarc_2), Parameter=0.5)  # -> Point, Tangent, Angle
negative = Negative(Value=merge)
plane_normal = PlaneNormal(Origin=evaluate_curve_3.Point, ZAxis=evaluate_curve_3.Tangent)
evaluate_curve_4 = EvaluateCurve(Curve=curve_bendingarc_2, Parameter=[0, 1])  # -> Point, Tangent, Angle
deconstruct_plane = DeconstructPlane(Plane=deconstruct_arc.BasePlane)  # -> Origin, XAxis, YAxis, ZAxis
point_oriented = PointOriented(BasePlane=plane_normal, UComponent=0, VComponent=0, WComponent=[negative, merge])
plane_normal_2 = PlaneNormal(Origin=point_oriented, ZAxis=evaluate_curve_3.Tangent)
construct_plane = ConstructPlane(Origin=evaluate_curve_4.Point, XAxis=deconstruct_plane.ZAxis, YAxis=evaluate_curve_4.Tangent)
plane_plane_plane = PlanePlanePlane(PlaneA=deconstruct_arc.BasePlane, PlaneB=construct_plane, PlaneC=plane_normal_2)  # -> flatten(Point), LineAB, LineAC, LineBC
reverse = Reverse(Vector=deconstruct_plane.ZAxis)
list_item = ListItem(List=plane_plane_plane.Point, Index=0, Wrap=True)
list_item_2 = ListItem(List=plane_plane_plane.Point, Index=1, Wrap=True)
list_item_3 = ListItem(List=evaluate_curve_4.Tangent, Index=0, Wrap=True)
list_item_4 = ListItem(List=plane_plane_plane.Point, Index=2, Wrap=True)
vector_2pt = Vector2Pt(PointA=list_item, PointB=list_item_2, Unitize=False)  # -> Vector, Length
construct_plane_2 = ConstructPlane(Origin=list_item, XAxis=list_item_3, YAxis=reverse)
construct_plane_3 = ConstructPlane(Origin=list_item_4, XAxis=vector_2pt.Vector, YAxis=reverse)
deconstruct_plane_2 = DeconstructPlane(Plane=construct_plane_3)  # -> Origin, XAxis, YAxis, ZAxis
deconstruct_plane_3 = DeconstructPlane(Plane=construct_plane_2)  # -> Origin, XAxis, YAxis, ZAxis
construct_plane_4 = ConstructPlane(Origin=deconstruct_plane_3.Origin, XAxis=deconstruct_plane_3.XAxis, YAxis=deconstruct_plane_3.ZAxis)
construct_plane_5 = ConstructPlane(Origin=deconstruct_plane_2.Origin, XAxis=deconstruct_plane_2.XAxis, YAxis=deconstruct_plane_2.ZAxis)
plane_orientationbeforebending = Plane(construct_plane_4)
plane_orientationafterbending = Plane(construct_plane_5)

deconstruct_plane_4 = DeconstructPlane(Plane=plane_baseplane)  # -> Origin, XAxis, YAxis, ZAxis
construct_plane_6 = ConstructPlane(Origin=deconstruct_plane_4.Origin, XAxis=deconstruct_plane_4.XAxis, YAxis=deconstruct_plane_4.ZAxis)
mirror = Mirror(Geometry=evaluate_curve.Point, Plane=construct_plane_6)  # -> Geometry, Transform
mirror_2 = Mirror(Geometry=point_endcontactpoint, Plane=construct_plane_6)  # -> Geometry, Transform
distance = Distance(PointA=mirror.Geometry, PointB=point_startcontactpoint)

point_endcontactpoint_2 = Point(point_endcontactpoint)
point_startcontactpoint_2 = Point(point_startcontactpoint)
plane_pinplane_3 = Plane(plane_pinplane)
deconstruct_plane_5 = DeconstructPlane(Plane=plane_pinplane_3)  # -> Origin, XAxis, YAxis, ZAxis
curve_beforebending = ClusterInput()
curve_afterbending = ClusterInput()
construct_plane_7 = ConstructPlane(Origin=point_startcontactpoint_2, XAxis=deconstruct_plane_5.YAxis, YAxis=deconstruct_plane_5.XAxis)
construct_plane_8 = ConstructPlane(Origin=point_endcontactpoint_2, XAxis=deconstruct_plane_5.YAxis, YAxis=deconstruct_plane_5.XAxis)
curve_beforebending_2 = Curve(curve_beforebending)
curve_afterbending_2 = Curve(curve_afterbending)
plane_orientationbeforebending_2 = Plane(plane_orientationbeforebending)
plane_orientationafterbending_2 = Plane(plane_orientationafterbending)
data_orientationstartbend = Data(construct_plane_7)
data_orientationendbend = Data(construct_plane_8)
orient = Orient(Geometry=curve_beforebending_2, Source=plane_orientationbeforebending_2, Target=data_orientationstartbend)  # -> Geometry, Transform
orient_2 = Orient(Geometry=curve_afterbending_2, Source=plane_orientationafterbending_2, Target=data_orientationendbend)  # -> Geometry, Transform
number_tuberadius = Number(number_piperadius_2)

curve_pipeafter = Curve(reparameterize(orient_2.Geometry))
curve_closest_point = CurveClosestPoint(Point=[point_endcontactpoint, mirror_2.Geometry], Curve=curve_pipeafter)  # -> Point, Parameter, Distance
shatter = Shatter(Curve=curve_pipeafter, Parameters=curve_closest_point.Parameter)
list_item_5 = ListItem(List=shatter, Index=1, Wrap=True)
length = Length(Curve=list_item_5)
subtraction = Subtraction(A=length, B=distance)
amplitude = Amplitude(Vector=deconstruct_plane_4.YAxis, Amplitude=expr("-x", subtraction))
curve_pipebefore = Curve(orient.Geometry)
move = Move(Geometry=curve_pipebefore, Motion=amplitude)  # -> Geometry, Transform
curve_pipeafter_2 = Curve(orient_2.Geometry)
curve_pipebefore_2 = Curve(move.Geometry)

mesh_pipe = MeshPipe(Polylines=curve_pipeafter_2, NumberOfSides=6, Tolerance=0.01, Radius=number_tuberadius, Cap=False, Join=False)
mesh_pipe_2 = MeshPipe(Polylines=curve_pipebefore_2, NumberOfSides=8, Tolerance=0.01, Radius=number_tuberadius, Cap=False, Join=False)
pipe = Pipe(Curve=curve_pipebefore_2, Radius=number_tuberadius, Caps=0)
pipe_2 = Pipe(Curve=curve_pipeafter_2, Radius=number_tuberadius, Caps=0)
brep_edges = BrepEdges(Brep=pipe)  # -> Naked, Interior, NonManifold
brep_edges_2 = BrepEdges(Brep=pipe_2)  # -> Naked, Interior, NonManifold
mesh_pipebefore = Mesh(mesh_pipe_2)
brep_pipebefore = Brep(pipe)
brep_pipeafter = Brep(pipe_2)
mesh_pipeafter = Mesh(mesh_pipe)
curve_pipebeforeedges = Curve([brep_edges.Interior, brep_edges.Naked])
curve_pipeafteredges = Curve([brep_edges_2.Naked, brep_edges_2.Interior])
curve_pipebeforeedges_2 = ClusterOutput(curve_pipebeforeedges)
curve_pipebefore_3 = ClusterOutput(curve_pipebefore_2)
brep_pipebefore_2 = ClusterOutput(brep_pipebefore)
mesh_pipebefore_2 = ClusterOutput(mesh_pipebefore)
curve_pipeafter_3 = ClusterOutput(curve_pipeafter_2)
mesh_pipeafter_2 = ClusterOutput(mesh_pipeafter)
curve_pipeafteredges_2 = ClusterOutput(curve_pipeafteredges)
brep_pipeafter_2 = ClusterOutput(brep_pipeafter)

# ==== cluster ClusterSelection
integer_previousstepcount = ClusterInput()
integer_nextstepcount = ClusterInput()
integer_previouspartcount = ClusterInput()
integer_nextpartcount = ClusterInput()
data_parts = ClusterInput()
integer_previousstepcount_2 = Integer(integer_previousstepcount)
integer_nextstepcount_2 = Integer(integer_nextstepcount)
data_parts_2 = Data(data_parts)
integer_previouspartcount_2 = Integer(integer_previouspartcount)
addition = Addition(A=integer_previousstepcount_2, B=integer_nextstepcount_2)
integer_nextpartcount_2 = Integer(integer_nextpartcount)
flatten_tree = FlattenTree(Tree=data_parts_2, Path="{0}")
data_parts_3 = Data(flatten_tree)
addition_2 = Addition(A=integer_previouspartcount_2, B=integer_nextpartcount_2)
list_length = ListLength(List=data_parts_3)
integer_partcount = Integer(list_length)
integer_partcount_2 = ClusterOutput(integer_partcount)
modulus = Modulus(A=addition_2, B=integer_partcount)
absolute = Absolute(Value=modulus)
boolean_overridepartselection = ClusterInput()
integer_partselection = ClusterInput()
boolean_overridepartselection_2 = Boolean(boolean_overridepartselection)
boolean_overridestepselection = ClusterInput()
integer_partselection_2 = Integer(integer_partselection)
integer_stepselection = ClusterInput()
boolean_overridestepselection_2 = Boolean(boolean_overridestepselection)
stream_filter = StreamFilter(Gate=boolean_overridepartselection_2, Stream0=absolute, Stream1=integer_partselection_2)
integer_stepselection_2 = Integer(integer_stepselection)
integer_partselectionindex = Integer(stream_filter)
integer_partselectionindex_2 = ClusterOutput(integer_partselectionindex)
split_list = SplitList(List=data_parts_3, Index=expr("x+1", integer_partselectionindex))  # -> ListA, ListB
list_item = ListItem(List=data_parts_3, Index=integer_partselectionindex, Wrap=True)
data_selectedpart = Data(list_item)
data_selectedpart_2 = Data(data_selectedpart)
explode = Explode(Curve=data_selectedpart_2, Recursive=True)  # -> Segments, Vertices
curve_bentcurvesegments = Curve(explode.Segments)
shift_list = ShiftList(List=curve_bentcurvesegments, Shift=1, Wrap=True)
cull_nth = CullNth(List=shift_list, CullFrequency=2)
list_length_2 = ListLength(List=cull_nth)
integer_stepcount = Integer(expr("x-1", list_length_2))
integer_stepcount_2 = ClusterOutput(integer_stepcount)
modulus_2 = Modulus(A=addition, B=integer_stepcount)
absolute_2 = Absolute(Value=modulus_2)
stream_filter_2 = StreamFilter(Gate=boolean_overridestepselection_2, Stream0=absolute_2, Stream1=integer_stepselection_2)
integer_stepselectionindex = Integer(stream_filter_2)
split_list_2 = SplitList(List=explode.Segments, Index=expr("x*2", integer_stepselectionindex))  # -> ListA, ListB
cull_index = CullIndex(List=split_list.ListA, Indices=-1, Wrap=True)
list_item_2 = ListItem(List=explode.Segments, Index=expr("x*2", integer_stepselectionindex), Wrap=False)
list_item_3 = ListItem(List=explode.Segments, Index=expr("x*2+1", integer_stepselectionindex), Wrap=True)
list_item_4 = ListItem(List=explode.Segments, Index=expr("x*2+2", integer_stepselectionindex), Wrap=False)
integer_stepselectionindex_2 = ClusterOutput(integer_stepselectionindex)
data_selectedpart_3 = ClusterOutput(data_selectedpart)
data_manufacturedparts = Data(cull_index)
data_unmanufacturedparts = Data(split_list.ListB)
curve_bendingarc = Curve(list_item_3)
curve_bendingstart = Curve(list_item_2)
curve_bent = Curve(split_list_2.ListA)
curve_unbent = Curve(split_list_2.ListB)
curve_bendingend = Curve(list_item_4)
curve_bent_2 = ClusterOutput(curve_bent)
curve_unbent_2 = ClusterOutput(curve_unbent)
curve_bendingstart_2 = ClusterOutput(curve_bendingstart)
curve_bendingarc_2 = ClusterOutput(curve_bendingarc)
data_manufacturedparts_2 = ClusterOutput(data_manufacturedparts)
data_unmanufacturedparts_2 = ClusterOutput(data_unmanufacturedparts)
join_curves = JoinCurves(Curves=[curve_bendingstart, curve_bendingarc, curve_bendingend], Preserve=False)
length = Length(Curve=curve_unbent)
mass_addition = MassAddition(Input=length)  # -> Result, PartialResults
curve_bending = Curve(join_curves)
curve_bending_2 = ClusterOutput(curve_bending)
join_curves_2 = JoinCurves(Curves=[curve_bent, join_curves], Preserve=False)
evaluate_curve = EvaluateCurve(Curve=reparameterize(join_curves_2), Parameter=1)  # -> Point, Tangent, Angle
evaluate_curve_2 = EvaluateCurve(Curve=reparameterize(curve_bendingstart), Parameter=0)  # -> Point, Tangent, Angle
length_2 = Length(Curve=curve_bending)
subtraction = Subtraction(A=mass_addition.Result, B=length_2)
line_sdl = LineSDL(Start=evaluate_curve_2.Point, Direction=curve_bendingstart, Length=mass_addition.Result)
line_sdl_2 = LineSDL(Start=evaluate_curve.Point, Direction=evaluate_curve.Tangent, Length=subtraction)
join_curves_3 = JoinCurves(Curves=[curve_bent, line_sdl], Preserve=False)
join_curves_4 = JoinCurves(Curves=[line_sdl_2, join_curves_2], Preserve=False)
curve_beforebending = Curve(join_curves_3)
curve_afterbending = Curve(join_curves_4)
curve_beforebending_2 = ClusterOutput(curve_beforebending)
curve_afterbending_2 = ClusterOutput(curve_afterbending)
